# Grasshopper definition Final.gh (Grasshopper 1.0.8)
# plug-ins: RhinoCodePluginGH, Pancake

number_slider = Slider(4, range=0..100)
X = UnitX(Factor=Slider(4, range=0..10))
arrpolar = PolarArray(Geometry=X, Plane=PlaneXY(0, 0, 0), Count=number_slider, Angle=Slider(1.571, range=0..10))  # -> simplify(Geometry), Transform
number_slider_2 = Slider(16, range=0..100)
number_slider_3 = Slider(6, range=0..10)
Z = UnitZ(Factor=Slider(4, range=0..10))
arrlinear = LinearArray(Geometry=arrpolar.Geometry, Direction=Z, Count=number_slider_2)  # -> Geometry, Transform
rectangle = Rectangle(Plane=PlaneXY(0, 0, 0), XSize=number_slider_3, YSize=number_slider_3, Radius=0)  # -> Rectangle, Length
series = Series(Start=Slider(1, range=0..100), Step=1, Count=number_slider)
dom = ConstructDomain(DomainStart=Slider(-2, range=-10..10), DomainEnd=Slider(2, range=0..10))
Z_2 = UnitZ(Factor=1)
number_slider_4 = Slider(0.2, range=0..1)
boxrec = BoxRectangle(Rectangle=rectangle.Rectangle, Height=number_slider_3)
line = LineSDL(Start=Z_2, Direction=Vector(0, 0, 1), Length=1)
random = Random(Range=dom, Number=number_slider_2, Seed=series)
cir = Circle(Plane=PlaneXY(0, 0, 0), Radius=Slider(8.1, range=0..10))
area = Area(Geometry=boxrec)  # -> Area, Centroid
debrep = DeconstructBrep(Brep=boxrec)  # -> Faces, Edges, Vertices
scale = Scale(Geometry=boxrec, Center=area.Centroid, Factor=0.8)  # -> Geometry, Transform
ma = MassAddition(Input=random)  # -> Result, simplify(PartialResults)
moveaway = MoveAwayFrom(Geometry=arrlinear.Geometry, Emitter=line, Distance=ma.PartialResults)  # -> Geometry, Transform
scale_2 = Scale(Geometry=cir, Center=Point(0, 0, 0), Factor=Slider(1.2, range=0..10))  # -> Geometry, Transform
join = BrepJoin(Breps=[scale.Geometry, boxrec])  # -> Breps, Closed
sph = Sphere(Base=debrep.Vertices, Radius=number_slider_4)
pipe = Pipe(Curve=debrep.Edges, Radius=number_slider_4, Caps=0)
pline = PolyLine(Vertices=moveaway.Geometry, Closed=False)
genes = GenePool(
    Decimals=2,
    Maximum=100,
    Minimum=0,
    Value=[62.33068858, 61.48399061, 44.12544791, 65.40557692, 52.64684697, 49.76191177, 38.33651245, 39.6110128, 54.65080307, 50.77680897])
number_slider_5 = Slider(10, range=1..100)
number_slider_6 = Slider(10, range=1..100)
number_slider_7 = Slider(10, range=1..100)
boundary = BoundarySurfaces(Edges=[scale_2.Geometry, cir])
Z_3 = UnitZ(Factor=Slider(4, range=0..10))
smoothpline = SmoothPolyline(Polyline=pline, Strength=1, Times=Slider(3, range=0..10))
cap = CapHoles(Brep=pipe)
series_2 = Series(Start=0, Step=1, Count=10)
bbox = BoundingBox(Content=boxrec, Plane=PlaneXY(0, 0, 0))  # -> Box, Box_2
extr = Extrude(Base=boundary, Direction=Z_3)
debox = DeconstructBox(Box=bbox.Box_2)  # -> Plane, X, Y, Z
vpipe = PipeVariable(Curve=smoothpline, Parameters=genes, Radii=series_2, Caps=0)
debrep_2 = DeconstructBrep(Brep=boxrec)  # -> Faces, Edges, Vertices
lng = ListLength(List=debox.Z)
lng_2 = ListLength(List=debox.Y)
lng_3 = ListLength(List=debox.X)
pipe_2 = Pipe(Curve=smoothpline, Radius=1, Caps=0)
sdivide = DivideSurface(Surface=debrep_2.Faces, UCount=Slider(19, range=0..100), VCount=Slider(7, range=0..10))  # -> simplify(Points), Normals, Parameters
dedomain = DeconstructDomain(Domain=debox.X)  # -> Start, End
division = Division(A=lng_2, B=number_slider_7)
division_2 = Division(A=lng_3, B=number_slider_6)
division_3 = Division(A=lng, B=number_slider_5)
dedomain_2 = DeconstructDomain(Domain=debox.Y)  # -> Start, End
vec = VectorXYZ(XComponent=0, YComponent=0, ZComponent=0)  # -> Vector, Length
neg = Negative(Value=sdivide.Normals)
addition = Addition(A=number_slider_6, B=1)
addition_2 = Addition(A=number_slider_7, B=1)
scale_nu = ScaleNU(Geometry=bbox.Box, Plane=PlaneXY(0, 0, 0), ScaleX=division_2, ScaleY=division, ScaleZ=division_3)  # -> Geometry, Transform
number_slider_8 = Slider(0.4, range=0..1)
addition_3 = Addition(A=number_slider_5, B=1)
move = Move(Geometry=sdivide.Points, Motion=neg)  # -> Geometry, Transform
arrrec = RectangularArray(Geometry=vec.Vector, Cell={Plane=PlaneXY(0, 0, 0), Size=Domain2(u=0..10, v=0..5)}, XCount=6, YCount=3)  # -> Geometry, Transform
truebutton = TrueOnlyButton(LastSaveLocalization="neutral,N")
vec_2 = VectorXYZ(XComponent=dedomain.Start, YComponent=dedomain_2.Start, ZComponent=0)  # -> Vector, Length
clean = CleanTree(RemoveNulls=True, RemoveInvalid=True, RemoveEmpty=False, Tree=sdivide.Points)
pt = Point(arrrec.Geometry)
arrbox = BoxArray(Geometry=vec_2.Vector, Cell=scale_nu.Geometry, XCount=addition, YCount=addition_2, ZCount=addition_3)  # -> Geometry, Transform
brepinc = PointInBrep(Brep=boxrec, Point=arrbox.Geometry, Strict=False)  # -> simplify(Inside)
cull = CullPattern(List=arrbox.Geometry, CullPattern=brepinc)
py3 = Python3Script(
    points=flatten(cull),
    max_len=Slider(50, range=0..100),
    max_dist=Slider(2.645, range=0..10),
    alpha=Slider(0.211, range=0..1),
    n_lines=Slider(10, range=0..100),
    buffer_radius=number_slider_8,
    regen=truebutton)  # -> out, lines; inputs points: list of Point3d, max_len: Int32, max_dist: Double, alpha: Double, n_lines: Int32, buffer_radius: Double, regen: Boolean
# ---------- py3: Python ----------
"""Grasshopper Script"""
import rhinoscriptsyntax as rs
import math
import random
from ghpythonlib import treehelpers as ght

class Point():
    def __init__(self, pos=None, vel=None, accel=None, is_free=True):
        self.pos = pos
        self.vel = vel
        self.accel = accel
        self.is_free = is_free
    
lines = []
free = []
DIST = 0
POINT = 1

def cos_similarity(direction, start, ends):
    dists = []
    dir_norm = rs.VectorLength(direction)
    for end in ends:
        vec = end - start
        v_norm = rs.VectorLength(vec)
        if (v_norm == 0 or dir_norm == 0):
            dists.append(-1)
            continue
        d = math.cos(math.pi*rs.VectorAngle(vec, direction)/180)
        dists.append(d)
        
    return dists

def make_line():
    line = []

    for i in range(max_len):
        if (len(points) <= 0): break

        # pick random point
        if (i == 0):
            # free = 
            rand_idx = random.randint(0, len(points)-1)
            next_point = points[rand_idx][POINT]
            line.append(next_point)
            points[rand_idx][POINT].is_free = False
            continue

        # find distances
        for ii in range(len(points)):
            # print(line[i-1].pos, points[ii][POINT].pos)
            points[ii][0] = rs.Distance(line[i-1].pos, points[ii][POINT].pos)
        nearby = [p for p in points if p[POINT].is_free and p[DIST] < max_dist]
        if (len(nearby) == 0): break

        if (i == 1):
            velocity = line[i-1].pos - line[i-2].pos
            acceleration = rs.CreatePoint([0,0,0])
            next_point = nearby[random.randint(0, len(nearby)-1)]
            next_point[POINT].vel = velocity
            next_point[POINT].accel = acceleration
            line[0].vel = velocity
            line[0].accel = acceleration
            line.append(next_point[POINT])
            if(next_point in points):
                points[points.index(next_point)][POINT].is_free = False
                points[points.index(next_point)][POINT].vel = velocity
                points[points.index(next_point)][POINT].accel = acceleration
            for p in points:
                temp_line = line[i-1].pos, line[i].pos
                # print(type(temp_line))
                # print(type(p[POINT].pos))
                # print(buffer_radius)
                d = rs.VectorLength(p[POINT].pos - rs.LineClosestPoint(temp_line, p[POINT].pos))
                if (d < buffer_radius):
                    points[points.index(p)][POINT].is_free = False
            continue

        used = [p for p in points if not p[POINT].is_free 
                and p[POINT] not in line[-2:]
                and p[POINT].vel is not None]
        # print(used)
        used.sort(key=lambda x: x[0])
        if (len(used) > 0 and used[0][DIST] < buffer_radius):
            # print("HERE")
            velocity = used[0][POINT].vel
            acceleration = used[0][POINT].accel
            print(velocity, acceleration)
        else:
            velocity = rs.VectorUnitize(line[i-1].pos - line[i-2].pos)
            acceleration = rs.VectorUnitize(velocity - line[i-1].vel)
            if acceleration is None: acceleration = rs.CreatePoint([0,0,0])

        direction = velocity*alpha + acceleration*(1-alpha)
        dists = cos_similarity(direction, line[i-1].pos, [p[POINT].pos for p in nearby])
        if (len(dists) == 0): break
        next_point = nearby[dists.index(max(dists))][POINT]
        next_point.vel = velocity
        next_point.accel = acceleration


        line.append(next_point)
        if (next_point in points):
            points[points.index(next_point)][POINT].is_free = False
            points[points.index(next_point)][POINT].vel = velocity
            points[points.index(next_point)][POINT].accel = acceleration
        for p in points:
            temp_line = rs.AddLine(line[i-1].pos, line[i].pos)
            d = rs.VectorLength(p[POINT].pos - rs.LineClosestPoint(temp_line, p[POINT].pos))
            if (d < buffer_radius):
                points[points.index(p)][POINT].is_free = False
            # if (rs.Distance(next_point.pos, p[POINT].pos) < buffer_radius):
                

    return line

def fill():

    for i in range(len(points)):
        points[i] = [0, Point(points[i])]

    for _ in range(n_lines):
        lines.append(make_line())


if (regen):
    fill()
    lines = [[l.pos for l in line] for line in lines]
    lines = ght.list_to_tree(lines)
# ---------- end py3 ----------
cullpt = CullDuplicates(Points=py3.lines, Tolerance=0.1, CullMode=3)  # -> simplify(Points), Indices, Valence
panel = Panel(py3.out)
prune = PruneTree(Tree=cullpt.Points, Minimum=Slider(2, range=0..10), Maximum=0)
pline_2 = PolyLine(Vertices=prune, Closed=False)
division_4 = Division(A=number_slider_8, B=2)
divlength = DivideLength(Curve=pline_2, Length=Slider(1, range=0..1))  # -> Points, Tangents, Parameters
pline_3 = PolyLine(Vertices=divlength.Points, Closed=False)
smoothpline_2 = SmoothPolyline(Polyline=pline_3, Strength=1, Times=Slider(3, range=0..10))  # -> simplify(Polyline)
number_slider_9 = Slider(0.4, range=0..1)
pframes = PerpFrames(Curve=smoothpline_2, Count=Slider(79, range=0..100), Align=True)  # -> Frames, Parameters
rectangle_2 = Rectangle(Plane=pframes.Frames, XSize=[division_4, number_slider_9], YSize=number_slider_9, Radius=Slider(0, range=0..1))  # -> simplify(Rectangle), Length
loft = Loft(
    Curves=rectangle_2.Rectangle,
    Options={Adjust=False, Closed=False, LoftEnds=0, LoftSimp=0, LoftType=0, Rebuild=10, Refit=0.01})
cap_2 = CapHoles(Brep=loft)
join_2 = BrepJoin(Breps=flatten(cap_2))  # -> Breps, Closed
truebutton_2 = TrueOnlyButton(LastSaveLocalization="neutral,N")
sunion = SolidUnion(Breps=join_2.Breps)
munion = MeshUnion(Meshes=join_2.Breps)
pcexportstl = ExportSTL(
    Mesh=munion,
    Relocate=True,
    SavePath="D:/School/csci7000-CF/mesh1.stl",
    SaveAsBinaryFile=True,
    SaveNow=truebutton_2,
    LastSaveLocalization="neutral,N")
panel_2 = Panel(pcexportstl)
