# Grasshopper definition L2.gh (Grasshopper 1.0.8)

# ---- group: Object / Make Grid / Base Shape
outer_radius = Slider(3, range=-100..100)
thickness = Slider(0.4, range=0..10)
subtraction = Subtraction(A=outer_radius, B=thickness)
cir = Circle(Plane=PlaneXY(0, 0, 0), Radius=outer_radius)
polygon = Polygon(
    Plane=PlaneXY(0, 0, 0),
    Radius=Slider(1.2, range=0..100),
    Segments=Slider(5, range=0..100),
    FilletRadius=Slider(0.1, range=0..100))  # -> Polygon, Length
cir_2 = Circle(Plane=PlaneXY(0, 0, 0), Radius=subtraction)

# ---- group: Object / Make Grid
num_layers = Slider(5, range=1..20)
height = Slider(2, range=0..10)
per_layer = Slider(6, range=1..20)

# ---- group: Object
curvature = Slider(1.1, range=-1.5..1.5)
scale = Slider(0.2, range=-10..10)
rotaton = Slider(0.3, range=-1.571..1.571)
X = UnitX(Factor=outer_radius)
geo = Geometry([cir_2, cir])
lng = ListLength(List=geo)
addition = Addition(A=lng, B=per_layer)
Z = UnitZ(Factor=height)

# ---- group: Object / Make Grid
move = Move(Geometry=polygon.Polygon, Motion=X)  # -> Geometry, Transform
arrpolar = PolarArray(Geometry=move.Geometry, Plane=PlaneXY(0, 0, 0), Count=per_layer, Angle=6.283185307)  # -> Geometry, Transform
geo_2 = Geometry([geo, arrpolar.Geometry])
flatten = FlattenTree(Tree=geo_2, Path="{0}")
arrlinear = LinearArray(Geometry=flatten, Direction=Z, Count=num_layers)  # -> Geometry, Transform

# ---- group: Object / Rotate by layer
area = Area(Geometry=arrlinear.Geometry)  # -> Area, flatten(Centroid)
series = Series(Start=0, Step=rotaton, Count=num_layers)
avr = Average(Input=area.Centroid)
Z_2 = UnitZ(Factor=1)
addition_2 = Addition(A=avr, B=Z_2)
ln = Line(StartPoint=avr, EndPoint=addition_2)
rotax = RotateAxis(Geometry=arrlinear.Geometry, Angle=series, Axis=ln)  # -> Geometry, Transform

# ---- group: Object (continued)
partition = PartitionList(List=rotax.Geometry, Size=addition)

# ----
abs = Absolute(Value=curvature)

# ---- group: Slicer
thickness_2 = Slider(1.6, range=0..10)
do_slicing = BooleanToggle(True)

# ---- group: Slicer / Make Planes
z_offset = Slider(0.1, range=0..10)
subtraction_2 = Subtraction(A=num_layers, B=Slider(1, range=0..1))
vec = VectorXYZ(XComponent=0, YComponent=0, ZComponent=z_offset)  # -> Vector, Length
multiplication = Multiplication(A=height, B=subtraction_2)
xy = XYPlane(Origin=vec.Vector)
division = Division(A=multiplication, B=thickness_2)
Z_3 = UnitZ(Factor=thickness_2)
round = Round(Number=division)  # -> Nearest, Floor, Ceiling

# ---- group: Object / Scale by Layer
flatten_2 = FlattenTree(Tree=partition, Path="{0}")
series_2 = Series(Start=0, Step=1, Count=num_layers)
series_3 = Series(Start=series_2, Step=num_layers, Count=addition)
item = ListItem(List=flatten_2, Index=series_3, Wrap=True)
series_4 = Series(Start=1, Step=scale, Count=num_layers)
area_2 = Area(Geometry=item)  # -> Area, Centroid
expression = Expression(x=curvature, Expression="If((x<0), -1, 1)")
series_5 = Series(Start=abs, Step=0, Count=num_layers)
avr_2 = Average(Input=area_2.Centroid)  # -> flatten(ArithmeticMean)
mm = MassMultiplication(Input=series_5)  # -> Result, PartialResults

# ----
multiplication_2 = Multiplication(A=mm.PartialResults, B=expression)

# ---- group: Object / Scale by Layer (continued)
pow = Power(A=series_4, B=multiplication_2)
scale_2 = Scale(Geometry=partition, Center=avr_2, Factor=pow)  # -> flatten(Geometry), Transform

# ---- group: Object / Loft
partition_2 = PartitionList(List=scale_2.Geometry, Size=num_layers)
loft = Loft(Curves=partition_2, Options={Adjust=False, Closed=False, LoftEnds=0, LoftSimp=0, LoftType=0, Rebuild=10, Refit=0.01})  # -> flatten(Loft)

# ---- group: Object / Combine
lng_2 = ListLength(List=loft)
subtraction_3 = Subtraction(A=lng_2, B=Slider(2, range=0..10))
item_2 = ListItem(List=loft, Index=Slider(1, range=0..10), Wrap=True)
item_3 = ListItem(List=loft, Index=Slider(0, range=0..10), Wrap=True)
series_6 = Series(Start=2, Step=1, Count=subtraction_3)
cap = CapHoles(Brep=item_2)
cap_2 = CapHoles(Brep=item_3)
item_4 = ListItem(List=loft, Index=series_6, Wrap=True)
cap_3 = CapHoles(Brep=item_4)
sdiff = SolidDifference(BrepsA=cap, BrepsB=cap_2)
join = BrepJoin(Breps=[cap_3, sdiff])  # -> flatten(Breps), Closed
sunion = SolidUnion(Breps=join.Breps)

# ---- group: Slicer (continued)
cull = CullPattern(List=sunion, CullPattern=do_slicing)

# ---- group: Slicer / Get XY size for slicing
bbox = BoundingBox(Content=cull, Plane=PlaneXY(0, 0, 0))  # -> Box, Box_2
boxprop = BoxProperties(Box=bbox.Box)  # -> Center, Diagonal, Area, Volume, Degeneracy
devec = DeconstructVector(Vector=boxprop.Diagonal)  # -> XComponent, YComponent, ZComponent
vec_2 = VectorXYZ(XComponent=devec.XComponent, YComponent=devec.YComponent, ZComponent=0)  # -> Vector, Length
multiplication_3 = Multiplication(A=vec_2.Vector, B=Slider(-0.5, range=-1..-0.5))

# ---- group: Slicer / Make Planes (continued)
planesrf = PlaneSurface(Plane=xy, XSize=boxprop.Diagonal, YSize=boxprop.Diagonal)
move_2 = Move(Geometry=planesrf, Motion=multiplication_3)  # -> Geometry, Transform
arrlinear_2 = LinearArray(Geometry=move_2.Geometry, Direction=Z_3, Count=round.Ceiling)  # -> Geometry, Transform

# ---- group: Slicer / Intersect
bbx = BrepBrep(BrepA=cull, BrepB=arrlinear_2.Geometry)  # -> Curves, Points
bbox_2 = BoundingBox(Content=bbx.Curves, Plane=PlaneXY(0, 0, 0), UnionBox=True)  # -> Box, Box_2
movetoplane = MoveToPlane(Geometry=bbx.Curves, Plane=PlaneXY(0, 0, 0), Above=True, Below=True)  # -> Geometry, Transform
boxprop_2 = BoxProperties(Box=bbox_2.Box)  # -> Center, Diagonal, Area, Volume, Degeneracy
vlen = VectorLength(Vector=boxprop_2.Diagonal)  # -> flatten(Length)
ma = MassAddition(Input=vlen)  # -> Result, PartialResults
X_2 = UnitX(Factor=ma.PartialResults)
movetoplane_2 = MoveToPlane(Geometry=bbox_2.Box, Plane=PlaneXY(0, 0, 0), Above=True, Below=True)  # -> Geometry, Transform
lng_3 = ListLength(List=X_2)
subtraction_4 = Subtraction(A=lng_3, B=Slider(2, range=0..10))
subset = SubList(List=X_2, Domain=subtraction_4, Wrap=True)  # -> List, Index
vec_3 = VectorXYZ(XComponent=0, YComponent=0, ZComponent=0)  # -> Vector, Length
unflatten = UnflattenTree(Tree=[vec_3.Vector, subset.List], Guide=bbox_2.Box)
move_3 = Move(Geometry=movetoplane_2.Geometry, Motion=unflatten)  # -> Geometry, Transform
move_4 = Move(Geometry=movetoplane.Geometry, Motion=unflatten)  # -> Geometry, Transform

# ---- group: Slicer / Possible Points for Numbers
boxprop_3 = BoxProperties(Box=move_3.Geometry)  # -> Center, Diagonal, Area, Volume, Degeneracy
number_slider = Slider(2, range=0..10)
number_slider_2 = Slider(10, range=0..100)
vec_4 = VectorXYZ(XComponent=0, YComponent=0, ZComponent=0)  # -> Vector, Length
rectangle = Rectangle(Plane=boxprop_3.Center, XSize=number_slider, YSize=number_slider, Radius=0)  # -> Rectangle, Length
multiplication_4 = Multiplication(A=boxprop_3.Diagonal, B=Slider(-0.5, range=-5..5))
pt = Point(vec_4.Vector)
arrrec = RectangularArray(Geometry=pt, Cell=rectangle.Rectangle, XCount=number_slider_2, YCount=number_slider_2)  # -> Geometry, Transform
move_5 = Move(Geometry=arrrec.Geometry, Motion=multiplication_4)  # -> Geometry, Transform

# ---- group: Slicer / Shrink Bounds
item_5 = ListItem(List=move_4.Geometry, Index=Slider(1, range=0..1), Wrap=True)
item_6 = ListItem(List=move_4.Geometry, Index=0, Wrap=True)
area_3 = Area(Geometry=item_5)  # -> Area, Centroid
area_4 = Area(Geometry=item_6)  # -> Area, Centroid
scale_3 = Scale(Geometry=item_5, Center=area_3.Centroid, Factor=Slider(1.1, range=0..2))  # -> Geometry, Transform
scale_4 = Scale(Geometry=item_6, Center=area_4.Centroid, Factor=Slider(0.9, range=0..10))  # -> Geometry, Transform

# ---- group: Slicer
lng_4 = ListLength(List=move_4.Geometry)  # -> flatten(Length)
X_3 = UnitX(Factor=Slider(0.5, range=0..1))
vec_5 = VectorXYZ(XComponent=0, YComponent=0, ZComponent=0)  # -> Vector, Length
lng_5 = ListLength(List=lng_4)
series_7 = Series(Start=0, Step=1, Count=lng_5)
planesrf_2 = PlaneSurface(Plane=PlaneXY(0, 0, 0), XSize=Domain(-10, 10), YSize=Domain(-10, 10))
ln_2 = Line(StartPoint=vec_5.Vector, EndPoint=X_3)
txt = Text(series_7)
textsrf = TextOnSurface(
    Text=txt,
    Font="Sans Bold:no Italic:no",
    Height=Slider(0.5, range=0..10),
    Depth=Slider(0, range=0..100),
    BaseLine=ln_2,
    BaseSurface=planesrf_2)

item_7 = ListItem(List=move_4.Transform, Index=0, Wrap=True)

move_6 = Move(Geometry=move_5.Geometry, Motion=item_7)  # -> Geometry, Transform
incurve = PointInCurve(Point=move_6.Geometry, Curve=scale_4.Geometry)  # -> Relationship, Point
cull_2 = CullPattern(List=move_6.Geometry, CullPattern=incurve.Relationship)
incurve_2 = PointInCurve(Point=cull_2, Curve=scale_3.Geometry)  # -> Relationship, Point
equals = Equality(FirstNumber=incurve_2.Relationship, SecondNumber=Slider(0, range=0..10))  # -> Equality, Inequality
cull_3 = CullPattern(List=cull_2, CullPattern=equals.Equality)
item_8 = ListItem(List=cull_3, Index=Slider(1, range=0..1), Wrap=True)
vec_6 = VectorXYZ(XComponent=0, YComponent=0, ZComponent=0)  # -> Vector, Length
vec2pt = Vector2Pt(PointA=vec_6.Vector, PointB=item_8, Unitize=False)  # -> Vector, Length
move_7 = Move(Geometry=textsrf, Motion=vec2pt.Vector)  # -> Geometry, Transform
mshadow = MeshShadow(Mesh=move_7.Geometry, Light=Vector(0, 0, -1), Plane=PlaneXY(0, 0, 0))

crv = Curve([move_4.Geometry, mshadow])
