# Grasshopper definition L3-3DPSlicerGcodeGeneratorBase.gh (Grasshopper 1.0.8)
# plug-ins: BullAnt, Pancake

center = Slider(105, range=0..500)
layer_height = Slider(0.3, range=0..10)
num_layers = Slider(1, range=0..10)
# [TODO]: Create Test Cylinder and Move to center of Bed
vec = VectorXYZ(XComponent=center, YComponent=center, ZComponent=0)  # -> Vector, Length
cir = Circle(Plane=PlaneXY(0, 0, 0), Radius=Slider(10, range=0..10))
Z = UnitZ(Factor=layer_height)
multiplication = Multiplication(A=Z, B=num_layers)
extr = Extrude(Base=cir, Direction=multiplication)
cap = CapHoles(Brep=extr)
move = Move(Geometry=cap, Motion=vec.Vector)  # -> Geometry, Transform

contour = Contour(Shape=move.Geometry, Point=Point(0, 0, 0), Direction=Vector(0, 0, 1), Distance=layer_height)
boundary = BoundarySurfaces(Edges=contour)

# ----
# [TODO]: Create Contours / Perimeters)
debox = DeconstructBox(Box=boundary)  # -> Plane, X, Y, Z
line_width = Slider(0.48, range=0..5)
infill = Slider(1, range=0..1)
dedomain = DeconstructDomain(Domain=debox.X)  # -> Start, End
dedomain_2 = DeconstructDomain(Domain=debox.Y)  # -> Start, End
dedomain_3 = DeconstructDomain(Domain=debox.Z)  # -> Start, End
num = Number(debox.X)
multiplication_2 = Multiplication(A=num, B=infill)
# [TODO]: Create Infill Patterns
addition = Addition(A=dedomain.Start, B=line_width)
division = Division(A=multiplication_2, B=line_width)
vec_2 = VectorXYZ(XComponent=dedomain.Start, YComponent=dedomain_2.End, ZComponent=dedomain_3.End)  # -> Vector, Length
vec_3 = VectorXYZ(XComponent=dedomain.Start, YComponent=dedomain_2.Start, ZComponent=dedomain_3.Start)  # -> Vector, Length
ln = Line(StartPoint=vec_3.Vector, EndPoint=vec_2.Vector)
division_2 = Division(A=num, B=division)
division_3 = Division(A=division, B=line_width)
neg = Negative(Value=line_width)
series = Series(Start=0, Step=division_2, Count=division_3)
division_4 = Division(A=neg, B=2)
X = UnitX(Factor=series)
move_2 = Move(Geometry=ln, Motion=X)  # -> Geometry, Transform
blx = BrepLine(Brep=boundary, Line=move_2.Geometry, LimitToFirst=False)  # -> Curves, Points
# [TODO]: Combine Perimeters and Infill
ext = ExtendCurve(Curve=blx.Curves, Type=0, Start=division_4, End=division_4)

# ---- group: A second line for testing
construct_point = ConstructPoint(XCoordinate=Slider(10, range=-10..30), YCoordinate=Slider(10, range=-10..30), ZCoordinate=Slider(1, range=-10..30))
construct_point_2 = ConstructPoint(XCoordinate=Slider(10, range=-10..30), YCoordinate=Slider(20, range=-10..30), ZCoordinate=Slider(1, range=-10..30))
line = Line(StartPoint=construct_point, EndPoint=construct_point_2)

# ---- group: Example of a line for testing
# [TODO]: Use lines for testing gcode generation then replace with line segments from slicing
number_slider = Slider(5, range=-10..30)
construct_point_3 = ConstructPoint(XCoordinate=number_slider, YCoordinate=Slider(1, range=-10..30), ZCoordinate=Slider(0, range=-10..30))
construct_point_4 = ConstructPoint(XCoordinate=Slider(30, range=-10..30), YCoordinate=Slider(1, range=-10..30), ZCoordinate=Slider(0, range=-10..30))
line_2 = Line(StartPoint=construct_point_3, EndPoint=construct_point_4)

# ----
line_3 = Line([line_2, line])
# [TODO]: Initialize Input Parameters
travel_feed_rate = Panel("0.4")
travel_feed_rate_2 = Panel("1.75")
travel_feed_rate_3 = Panel("1200")
# NOTE THAT THIS GCODE OUTPUT ASSUMES:
# - A PRUSA MK3S+ as the Printer
# - PLA Material
# - Extrusion Temperature: 215C
# - Heated Bed Temperature: 60C
travel_feed_rate_4 = Panel("600")
# [TODO]: Use Pancake Plug-in to Export Gcode Output File as .gcode
panel = Panel("D:/School/csci7000-CF/L3/ouput.gcode")
truebutton = TrueOnlyButton(LastSaveLocalization="neutral,N")

trim = TrimTree(Tree=ext, Depth=Slider(2, range=0..10))

# ---- group: Optimize Lines
number_slider_2 = Slider(2, range=0..10)
lng = ListLength(List=trim)
series_2 = Series(Start=1, Step=number_slider_2, Count=lng)
series_3 = Series(Start=0, Step=number_slider_2, Count=lng)
item = ListItem(List=trim, Index=series_3, Wrap=False)
item_2 = ListItem(List=trim, Index=series_2, Wrap=False)
clean = CleanTree(RemoveNulls=True, RemoveInvalid=True, RemoveEmpty=False, Tree=item)
clean_2 = CleanTree(RemoveNulls=True, RemoveInvalid=True, RemoveEmpty=False, Tree=item_2)
flip = FlipCurve(Curve=clean_2)  # -> Curve, Flag
weave = Weave(Pattern=[0, 1], Stream0=clean, Stream1=flip.Curve, NullGaps=False)
connect = ConnectCurves(Curves=weave, Continuity=2, Close=False, Bulge=0)

# ----
# [TODO]: Create Line Segments from Perimeters and Infill
merge = Merge(Data1=boundary, Data2=connect)

divlength = DivideLength(Curve=merge, Length=Slider(0.1, range=0..0.1))  # -> Points, Tangents, Parameters
pline = PolyLine(Vertices=divlength.Points, Closed=False)  # -> simplify(Polyline)
ggspl = GgSimplifyPolyline(Polyline=pline, Tol=0.001)
explode = Explode(Curve=ggspl, Recursive=True)  # -> Segments, Vertices

line_4 = Line(explode.Segments)
# [TODO]: Implement the gcode generation algorithm in Python
ghpython_script = GhPythonScript(
    lines=flatten(line_4),
    nozzle_diameter=travel_feed_rate,
    filament_diameter=travel_feed_rate_2,
    layer_height=layer_height,
    extrusion_width=line_width,
    travel_feed_rate=travel_feed_rate_3,
    layer_change_feed_rate=travel_feed_rate_4)  # -> out, gcode_output; inputs lines: list of Line
# ---------- ghpython_script: Python ----------
"""
    This file contains parameters, helpers, and setup to 
    create a basic gcode generation algorithm from line segments.
    
    The main 
    
    
    Inputs:
        lines: the line segments to be converted into gcode commands for extrusion 
        nozzle_diameter: the diameter of the 3D printer's nozzle
        filament_diameter: the diameter of the 3d printing filament
        layer_height: the height of each layer in the print
        extrusion_width: the width of the extruded line from the printer
        travel_feed_rate: the speed at which the extruder moves in X and Y
        layer_change_feed_rate: the speed at which teh extruder moves when 
            changing layers in the Z direction
        extrusion_feed_rate: the speed at which the extruder move when extruding

    Output:
        gcode_output: a string with gcode commands separate by new-lines"""

__author__ = "mrivera-cu"

import rhinoscriptsyntax as rs

import math


########## CONSTANTS BELOW ###############

# GCODE COMMANDS
COMMAND_MOVE = "G1"

# GCODE PARAM NAMES
PARAM_X = "X"
PARAM_Y = "Y"
PARAM_Z = "Z"
PARAM_E = "E"
PARAM_F = "F"

# Separates commands
COMMAND_DELIMITER = "\n"

# Precision for converting floats to strings
E_VALUE_PRECISION = 5
XYZ_VALUE_PRECISION = 3

# Float equality precision
FLOAT_EQUALITY_PRECISION = 5

#### WARNING: DO NOT EDIT THE START GCODE! #####
start_gcode_lines = [";START GCODE",
    "M201 X1000 Y1000 Z200 E5000 ; sets maximum accelerations, mm/sec^2",
    "M203 X200 Y200 Z12 E120 ; sets maximum feedrates, mm / sec",
    "M204 S1250 T1250 ; sets acceleration (S) and retract acceleration (R), mm/sec^2",
    "M205 X8.00 Y8.00 Z0.40 E4.50 ; sets the jerk limits, mm/sec",
    "M205 S0 T0 ; sets the minimum extruding and travel feed rate, mm/sec",
    ";TYPE:Custom",
    "M862.3 P \"MK3S\" ; printer model check",
    "M862.1 P0.4 ; nozzle diameter check",
    "M115 U3.13.3 ; tell printer latest fw version",
    "G90 ; use absolute coordinates",
    "M83 ; extruder relative mode",
    "M104 S215 ; set extruder temp",
    "M140 S60 ; set bed temp",
    "M190 S60 ; wait for bed temp",
    "M109 S215 ; wait for extruder temp",
    "G28 W ; home all without mesh bed level",
    "G80 X86.6877 Y64.7708 W85.2412 H59.1573 ; mesh bed levelling",
    "G1 Z0.2 F720",
    "G1 Y-3 F1000 ; go outside print area",
    "G92 E0",
    "G1 X60 E9 F1000 ; intro line",
    "G1 X100 E12.5 F1000 ; intro line",
    "G92 E0",
    "M221 S95",
    "; Don't change E values below. Excessive value can damage the printer.",
    "M907 E538 ; set extruder motor current",
    "G21 ; set units to millimeters",
    "G90 ; use absolute coordinates",
    "M83 ; use relative distances for extrusion",
    "M900 K0.05 ; Filament gcode LA 1.5",
    "M900 K30 ; Filament gcode LA 1.0",
    "M107"]
    
##### WARNING: DO NOT EDIT THE END GCODE! ######
end_gcode_lines = ["; END Gcode", 
    "M204 S1000", 
    "M107", 
    ";TYPE:Custom", 
    "; Filament-specific end gcode", 
    "G1 Z180 F720 ; Move print head further up", 
    "G1 X0 Y200 F3600 ; park", 
    "G4 ; wait",
    "M221 S100 ; reset flow",
    "M900 K0 ; reset LA",
    "M104 S0 ; turn off temperature",
    "M140 S0 ; turn off heatbed",
    "M107 ; turn off fan",
    "M84 ; disable motors",
    "M73 P100 R0 ; print progress done",
    "M73 Q100 S0 ; print progress done"]

#########################################################################

# Converts a float (f) to a string with some precision of decimal places
# For example: 
# Input: f=0.1234, precision=3 
# Output: "0.123"
def float_to_string(f, precision=XYZ_VALUE_PRECISION): 
    f = float(f)
    str_format = "{value:." + str(precision) +"f}"
    return str_format.format(value=f)
    
# Helper to convert the E value to the proper precision
def e_value_to_string(e):
    return float_to_string(e, E_VALUE_PRECISION)

# Helper to convert the XYZ value to the proper precision
def xyz_value_to_string(e):
    return float_to_string(e, XYZ_VALUE_PRECISION)

#########################################################################

# Helper function to compare floats in grasshopper/python due to float precision errors
def are_floats_equal(f1, f2, epsilon=10**(-FLOAT_EQUALITY_PRECISION)):
    f1 *= 10**FLOAT_EQUALITY_PRECISION
    f2 *= 10**FLOAT_EQUALITY_PRECISION
    return math.fabs(f2 - f1) <= epsilon
    
# Helper function to compare if two points are equal (have the same coordinates)
# by handling float precision comparisons
def is_same_pt(ptA, ptB):
    return are_floats_equal(ptA[0], ptB[0]) and are_floats_equal(ptA[1], ptB[1]) and are_floats_equal(ptA[2], ptB[2])
     
     
########################################################################
# creates a string consisting of a G1 move command and 
# any associated parameters
def gcode_move(current_pos, next_pos, feed_rate=None, should_extrude=False):
    # Start with "G1" as command
    move_command_str = COMMAND_MOVE
    
    # Compare X positions
    if (not are_floats_equal(current_pos[0],next_pos[0])):
        # we have a different x position so add it as a parameter to the command
        x_value = float_to_string(next_pos[0], precision=XYZ_VALUE_PRECISION)
        # Add X<x_value> to move string, e.g., X100.00
        move_command_str += " " + PARAM_X + x_value
    
    # Compare Y positions
    if (not are_floats_equal(current_pos[1], next_pos[1])):
        # we have a different y position so add the new position as a parameter
        y_value = float_to_string(next_pos[1], precision=XYZ_VALUE_PRECISION)
        # Add Y<y_value> to move string, e.g., Y100.00
        move_command_str += " " + PARAM_Y + y_value
    
    # Compare Z position
    if (not are_floats_equal(current_pos[2], next_pos[2])):
        # we have a different z position so add the new position as a parameter
        z_value = float_to_string(next_pos[2], precision=XYZ_VALUE_PRECISION)
        # Add Z<z_value> to move string, e.g., Z100.00
        move_command_str += " " + PARAM_Z + z_value
        
    
    # [TODO]: handle "should_extrude" == true by determining the proper amount to
    # extrude using the capsule model, then append the E parameter and value
    # to the move command.
    # NOTE: YOUR FLOAT PRECISION MUST MATCH E_VALUE_PRECISION
    if (should_extrude):
        area = math.pi*(layer_height/2)**2 + (extrusion_width-layer_height)*layer_height
        dx = next_pos[0] - current_pos[0]
        dy = next_pos[1] - current_pos[1]
        dz = next_pos[2] - current_pos[2]
        length = math.sqrt(dx**2 + dy**2 + dz**2)
        vol = area*length
        len = vol/(math.pi*(filament_diameter/2)**2)
        e_value = float_to_string(len, precision=E_VALUE_PRECISION)
        move_command_str += " " + PARAM_E + e_value
    
    
    # See if we have a feedrate to use, and handle it differently than other 
    # parameters as it is an integer value
    if (feed_rate is not None):
        # feed rate is an int
        feed_rate_value = round(feed_rate)
        # Add F<feed_rate_value> to move string, e.g., F2000
        move_command_str += " " + PARAM_F + str(feed_rate_value)   
    
    # Remove excess whitespace on ends
    move_command_str = move_command_str.strip(" ")
    print(move_command_str)
    
    return move_command_str


############################################
############################################
############################################
    
''' Here's the main method of the script that uses the helper methods above '''

def generate_gcode():

    # [TODO]: Implement the algorithm to generate gcode for each layer by 
    # first to moveing to the layer height, then moving to each line segment.
    # Once at a line segment, you should move and extrude along it, 
    # then move (travel) to the next line until there are no lines left
    # For each of these movements, you should append the command to
    # the list: `all_move_commands`
    current_position = [0, 0, 0]        # start extruder at the origin
    all_move_commands = []              # list to hold for all the move commands

    for i in range(0, len(lines)):
        # Get pts of the line segment
        line = lines[i]
        line_start_position = line[0]
        line_end_position = line[1]
        
        # [TODO]: Handle moving to the next layer (Z Position)
        # NOTE- ALL Z MOVEMENTS SHOULD:
        # 1) BE INDEPENDENT MOVES(e.g., G1 Z# and not move with other positions like XYE) 
        # 2) USE THE `layer_change_feedrate`
        # 3) BE IN INCREASING ORDER
        if not (current_position[2] == line_start_position[2]):
            next_layer = [current_position[0], current_position[1], line_start_position[2]]
#            print(current_position, next_layer)
            move_z = gcode_move(current_position, next_layer, feed_rate=layer_change_feed_rate)
            all_move_commands.append(move_z)
            current_position[2] = line_start_position[2]

        # Now if our current_position is not the start of our line segment
        # we need to move (travel) to the line segment's starting point
        if not is_same_pt(current_position, line_start_position):
            # [Move to the the line_start_position
            move_to_line_start_command = gcode_move(current_position, line_start_position, feed_rate=travel_feed_rate)
            # A ppend command
            all_move_commands.append(move_to_line_start_command)
        
        # [TODO]: Once our extruder is at the start of the line, create a 
        # command to move AND extrude along 
        # the line segment using `extrusion_feed_rate`
        extrude_command = gcode_move(line_start_position, line_end_position, feed_rate=extrusion_feed_rate, should_extrude=True)

        # [TODO]: Append the move command across the line segment 
        all_move_commands.append(extrude_command)
        
        # [TODO]: Update the current position of our extruder to be at the end of the line
        current_position = line_end_position
        
    # End of for-loop above -- now create the full set of commands


    # [TODO]: Once you have all of the move commands stored as a list in
    # `all_move_commands`, combine the `start_gcode`, `all_move_commands`, and `end_gcode`
    # into one list called `gcode_lines`   
    gcode_lines = [] 
    gcode_lines += start_gcode_lines
    gcode_lines += all_move_commands
    gcode_lines += end_gcode_lines

    # --- DO NOT EDIT BELOW ----
    # The takes the combined gcode_lines list and creates a string containing each line
    # separated by a COMMAND_DELIMITER (the new-line character), and sets it 
    # to the `gcode_output`variable of this component
    output = COMMAND_DELIMITER.join(gcode_lines)
    
    return output
    
''' RUN THE MAIN FUNCITON ABOVE - DO NOT EDIT '''
# this sets the gcode commands to be the the `gcode_output` variable of this grasshopper component
gcode_output = generate_gcode()
# ---------- end ghpython_script ----------
the_gcode_output = Panel(ghpython_script.gcode_output)
debugging_panel = Panel(ghpython_script.out)
pcexporttxt = ExportTXT(
    Content=the_gcode_output,
    FileLocation=panel,
    Overwrite=Toggle(True),
    Encoding="utf-8",
    Export=truebutton,
    LastSaveLocalization="neutral,N")
