# Grasshopper definition L3_autosave.gh (Grasshopper 1.0.8)
# plug-ins: BullAnt

center = Slider(105, range=0..500)
layer_height = Slider(0.3, range=0..10)
num_layers = Slider(1, range=0..10)
vec = VectorXYZ(XComponent=center, YComponent=center, ZComponent=0)  # -> Vector, Length
cir = Circle(Plane=PlaneXY(0, 0, 0), Radius=Slider(10, range=0..10))
Z = UnitZ(Factor=layer_height)
multiplication = Multiplication(A=Z, B=num_layers)
extr = Extrude(Base=cir, Direction=multiplication)
cap = CapHoles(Brep=extr)
move = Move(Geometry=cap, Motion=vec.Vector)  # -> Geometry, Transform

contour = Contour(Shape=move.Geometry, Point=Point(0, 0, 0), Direction=Vector(0, 0, 1), Distance=layer_height)
boundary = BoundarySurfaces(Edges=contour)
debox = DeconstructBox(Box=boundary)  # -> Plane, X, Y, Z
line_spacing = Slider(0, range=0..10)
line_width = Slider(0.5, range=0..10)
infill = Slider(0, range=0..1)
dedomain = DeconstructDomain(Domain=debox.X)  # -> Start, End
dedomain_2 = DeconstructDomain(Domain=debox.Y)  # -> Start, End
dedomain_3 = DeconstructDomain(Domain=debox.Z)  # -> Start, End
addition = Addition(A=dedomain.Start, B=line_width)
num = Number(debox.X)
addition_2 = Addition(A=line_width, B=line_spacing)
vec_2 = VectorXYZ(XComponent=addition, YComponent=dedomain_2.Start, ZComponent=dedomain_3.Start)  # -> Vector, Length
vec_3 = VectorXYZ(XComponent=dedomain.Start, YComponent=dedomain_2.End, ZComponent=dedomain_3.End)  # -> Vector, Length
division = Division(A=num, B=line_width)
series = Series(Start=0, Step=addition_2, Count=division)
ln = Line(StartPoint=vec_2.Vector, EndPoint=vec_3.Vector)
X = UnitX(Factor=series)
move_2 = Move(Geometry=ln, Motion=X)  # -> Geometry, Transform
blx = BrepLine(Brep=boundary, Line=move_2.Geometry, LimitToFirst=False)  # -> Curves, Points
trim = TrimTree(Tree=blx.Curves, Depth=Slider(2, range=0..10))
merge = Merge(Data1=boundary, Data2=trim)
divlength = DivideLength(Curve=merge, Length=Slider(0.1, range=0..0.1))  # -> Points, Tangents, Parameters
pline = PolyLine(Vertices=divlength.Points, Closed=False)  # -> simplify(Polyline)
ggspl = GgSimplifyPolyline(Polyline=pline, Tol=0.001)
explode = Explode(Curve=ggspl, Recursive=True)  # -> Segments, Vertices
