# Grasshopper definition HilbertCurve.gh (Grasshopper 0.9.62)

hilbertcurve = VBScript(Depth=Slider(3, range=0..10))  # -> out, A
# ---------- hilbertcurve: VB ----------
    'code based on http://www.vb-helper.com/howto_fractal_hilbert_curve.html - altered by Marc Hoppermann 

    HilbertList.clear
    Dim fractalDepth As Double = Depth

    ' Get the parameters.
    Dim total_length As Double
    Dim start_x As Double
    Dim start_y As Double
    Dim start_length As Double
    Dim frame_size As Double

    frame_size = 1000
    total_length = frame_size

    start_x = Cint((frame_size - total_length) / 2)
    start_y = Cint((frame_size - total_length) / 2)

    ' Compute the side length for this level.
    start_length = total_length / (2 ^ fractalDepth)

    m_X = start_x
    m_Y = start_y

    Call Hilbert(fractalDepth, start_length, 0)
    A = HilbertList
# ---------- hilbertcurve: VB additional code ----------
  Dim m_X As Double
  Dim m_Y As Double
  Dim HilbertList As New List(Of Line)

  Sub Hilbert(ByVal depth, ByVal dx, ByVal dy)
    If depth > 1 Then Call Hilbert(depth - 1, dy, dx)
    Call DrawRelative(dx, dy)
    If depth > 1 Then Call Hilbert(depth - 1, dx, dy)
    Call DrawRelative(dy, dx)
    If depth > 1 Then Call Hilbert(depth - 1, dx, dy)
    Call	DrawRelative(-dx, -dy)
    If depth > 1 Then Call Hilbert(depth - 1, -dy, -dx)
  End Sub

  Sub DrawRelative(ByVal dx, ByVal dy)
    HilbertList.add(New Line(New point3d(m_X, m_Y, 0), New point3d(m_X + dx, m_Y + dy, 0)))
    m_X = m_X + dx
    m_Y = m_Y + dy
  End Sub
# ---------- end hilbertcurve ----------
