# Grasshopper definition L3.gh (Grasshopper 1.0.8)
# plug-ins: BullAnt, Pancake

layer_height = Slider(0.3, range=0..10)
center = Slider(105, range=0..500)
tolerance = Slider(0.001, range=0..0.1)
num_layers = Slider(5, range=0..10)
subtraction = Subtraction(A=layer_height, B=tolerance)
# [TODO]: Create Test Cylinder and Move to center of Bed
vec = VectorXYZ(XComponent=center, YComponent=center, ZComponent=0)  # -> Vector, Length
cir = Circle(Plane=PlaneXY(0, 0, 0), Radius=Slider(10, range=0..10))
Z = UnitZ(Factor=subtraction)
multiplication = Multiplication(A=Z, B=num_layers)
extr = Extrude(Base=cir, Direction=multiplication)
cap = CapHoles(Brep=extr)
move = Move(Geometry=cap, Motion=vec.Vector)  # -> Geometry, Transform

line_width = Slider(0.48, range=0..5)
infill = Slider(0.69, range=0..1)
infill_2 = ValueList({"Linear": 0, "Honeycomb": 1, "Concentric": 2, "Hilbert": 3}, selected="Linear")

contour = Contour(Shape=move.Geometry, Point=Point(0, 0, 0), Direction=Vector(0, 0, 1), Distance=layer_height)
boundary = BoundarySurfaces(Edges=contour)
# [TODO]: Create Contours / Perimeters)
gate = StreamGate(Stream=boundary, Gate=infill_2)  # -> Target0, Target1, Target2, Target3

debox = DeconstructBox(Box=gate.Target0)  # -> Plane, X, Y, Z
dedomain = DeconstructDomain(Domain=debox.X)  # -> Start, End
dedomain_2 = DeconstructDomain(Domain=debox.Y)  # -> Start, End
dedomain_3 = DeconstructDomain(Domain=debox.Z)  # -> Start, End
num = Number(debox.X)
multiplication_2 = Multiplication(A=num, B=infill)
addition = Addition(A=dedomain.Start, B=line_width)
division = Division(A=multiplication_2, B=line_width)
vec_2 = VectorXYZ(XComponent=dedomain.Start, YComponent=dedomain_2.End, ZComponent=dedomain_3.End)  # -> Vector, Length
# [TODO]: Create Infill Patterns
vec_3 = VectorXYZ(XComponent=dedomain.Start, YComponent=dedomain_2.Start, ZComponent=dedomain_3.Start)  # -> Vector, Length
ln = Line(StartPoint=vec_3.Vector, EndPoint=vec_2.Vector)
division_2 = Division(A=num, B=division)
division_3 = Division(A=division, B=line_width)
neg = Negative(Value=line_width)
series = Series(Start=0, Step=division_2, Count=division_3)
division_4 = Division(A=neg, B=2)
X = UnitX(Factor=series)
move_2 = Move(Geometry=ln, Motion=X)  # -> Geometry, Transform
blx = BrepLine(Brep=gate.Target0, Line=move_2.Geometry, LimitToFirst=False)  # -> Curves, Points
ext = ExtendCurve(Curve=blx.Curves, Type=0, Start=division_4, End=division_4)
trim = TrimTree(Tree=ext, Depth=Slider(2, range=0..10))

# ---- group: Concentric Infill
debox_2 = DeconstructBox(Box=gate.Target2)  # -> Plane, X, Y, Z
area = Area(Geometry=gate.Target2)  # -> Area, Centroid
num_2 = Number(debox_2.X)
division_5 = Division(A=line_width, B=infill)
division_6 = Division(A=num_2, B=line_width)
neg_2 = Negative(Value=division_5)
series_2 = Series(Start=num_2, Step=neg_2, Count=division_6)
subtraction_2 = Subtraction(A=series_2, B=line_width)
division_7 = Division(A=subtraction_2, B=num_2)
neg_3 = Negative(Value=division_7)
scale = Scale(Geometry=gate.Target2, Center=area.Centroid, Factor=neg_3)  # -> Geometry, Transform
bcx = BrepCurve(Brep=gate.Target2, Curve=scale.Geometry)  # -> Curves, Points
clean = CleanTree(RemoveNulls=True, RemoveInvalid=True, RemoveEmpty=True, Tree=bcx.Curves)
trim_2 = TrimTree(Tree=clean, Depth=Slider(2, range=0..10))

# ---- group: Hex Infill
debox_3 = DeconstructBox(Box=gate.Target1)  # -> Plane, X, Y, Z
num_3 = Number(debox_3.X)
num_4 = Number(debox_3.Y)
area_2 = Area(Geometry=gate.Target1)  # -> Area, Centroid
num_5 = Number(debox_3.Z)
division_8 = Division(A=line_width, B=2)
vec_4 = VectorXYZ(XComponent=num_3, YComponent=num_4, ZComponent=num_5)  # -> Vector, Length
division_9 = Division(A=division_8, B=infill)
division_10 = Division(A=vec_4.Vector, B=2)
multiplication_3 = Multiplication(A=division_9, B=Slider(1.1547, range=0..10))
subtraction_3 = Subtraction(A=area_2.Centroid, B=division_10)
division_11 = Division(A=num_3, B=multiplication_3)
division_12 = Division(A=num_4, B=multiplication_3)
hexgrid = Hexagonal(Plane=subtraction_3, Size=multiplication_3, ExtentX=division_11, ExtentY=division_12)  # -> Cells, Points
clean_2 = CleanTree(RemoveNulls=True, RemoveInvalid=True, RemoveEmpty=True, Tree=hexgrid.Cells)
trim_3 = TrimTree(Tree=clean_2, Depth=Slider(2, range=0..10))
bcx_2 = BrepCurve(Brep=gate.Target1, Curve=trim_3)  # -> Curves, Points
clean_3 = CleanTree(RemoveNulls=True, RemoveInvalid=True, RemoveEmpty=True, Tree=bcx_2.Curves)
trim_4 = TrimTree(Tree=clean_3, Depth=1)

# ---- group: Optimize Lines
number_slider = Slider(2, range=0..10)
lng = ListLength(List=trim)
series_3 = Series(Start=1, Step=number_slider, Count=lng)
series_4 = Series(Start=0, Step=number_slider, Count=lng)
item = ListItem(List=trim, Index=series_3, Wrap=False)
item_2 = ListItem(List=trim, Index=series_4, Wrap=False)
clean_4 = CleanTree(RemoveNulls=True, RemoveInvalid=True, RemoveEmpty=False, Tree=item_2)
clean_5 = CleanTree(RemoveNulls=True, RemoveInvalid=True, RemoveEmpty=False, Tree=item)
flip = FlipCurve(Curve=clean_5)  # -> Curve, Flag
weave = Weave(Pattern=[0, 1], Stream0=clean_4, Stream1=flip.Curve, NullGaps=False)
connect = ConnectCurves(Curves=weave, Continuity=2, Close=False, Bulge=0)

# ----
# [TODO]: Initialize Input Parameters
travel_feed_rate = Panel("0.4")
travel_feed_rate_2 = Panel("1.75")
travel_feed_rate_3 = Panel("1200")
# NOTE THAT THIS GCODE OUTPUT ASSUMES:
# - A PRUSA MK3S+ as the Printer
# - PLA Material
# - Extrusion Temperature: 215C
# - Heated Bed Temperature: 60C
travel_feed_rate_4 = Panel("600")
# [TODO]: Use Pancake Plug-in to Export Gcode Output File as .gcode
panel = Panel("D:/School/csci7000-CF/L3/ouput.gcode")
truebutton = TrueOnlyButton(LastSaveLocalization="neutral,N")

# ---- group: Hilbert Infill
area_3 = Area(Geometry=gate.Target3)  # -> Area, Centroid
debox_4 = DeconstructBox(Box=gate.Target3)  # -> Plane, X, Y, Z
num_6 = Number(debox_4.X)
multiplication_4 = Multiplication(A=num_6, B=infill)
num_7 = Number(debox_4.X)
num_8 = Number(debox_4.Y)
num_9 = Number(debox_4.Z)
division_13 = Division(A=multiplication_4, B=line_width)
division_14 = Division(A=num_6, B=division_13)
vec_5 = VectorXYZ(XComponent=num_7, YComponent=num_8, ZComponent=num_9)  # -> Vector, Length
neg_4 = Negative(Value=vec_5.Vector)
ghpython_script = GhPythonScript(scale=division_14, num_iterations=Slider(6, range=0..10))  # -> out, points; inputs num_iterations: Int32
# ---------- ghpython_script: Python ----------
import rhinoscriptsyntax as rs

out_points = [rs.CreatePoint(0,0,0)]

class LSystem:
  def __init__(self, axiom, rules, move_distance, rotate_angle, scale_factor):
    self.axiom = axiom
    self.current_iteration = axiom
    self.move_distance = move_distance
    self.rotate_angle = rotate_angle
    self.scale_factor = scale_factor
    self.rules = rules
    self.pos = (0,0,0)
    self.dir = (scale_factor,0,0) # unit x
    self.reset()
  
  def iterate(self):
    current = self.current_iteration
    
    self.clearCurrentStringBuffer()
    
    for i in range(len(current)):
      if current[i] in self.rules.keys(): self.current_iteration += self.rules[current[i]]
      else: self.current_iteration += current[i]
 
    self.iteration_num += 1
  
  def draw_LSystem(self):
    dist = self.move_distance
    angle = self.rotate_angle
    
    if (self.scale_factor != 0):
      iteration_num = self.iteration_num
      dist = dist / (self.scale_factor*(self.iteration_num + 1))
    
    current_it = self.current_iteration
    
    for i in range(len(current_it)):
      c = current_it[i]
      if c == 'F':
          self.pos = (self.pos[0] + self.dir[0], self.pos[1] + self.dir[1], self.pos[2] + self.dir[2])
          out_points.append(rs.CreatePoint(self.pos[0], self.pos[1], self.pos[2]))
#          print("forward", self.pos)
      elif c == '+':
          self.dir = (-1*self.dir[1], self.dir[0], 0)
#          out_points.append(rs.CreatePoint(self.pos[0], self.pos[1], self.pos[2]))
#          print("left", self.dir)
      elif c == '-':
          self.dir = (self.dir[1], -1*self.dir[0], 0)
#          out_points.append(rs.CreatePoint(self.pos[0], self.pos[1], self.pos[2]))
#          print("right", self.dir)
  
  def reset(self):
    self.iteration_num = 0
    self.current_iteration = self.axiom
  
  def clearCurrentStringBuffer(self):
    self.current_iteration = ""

def init_hilbert():
  move_dist = 1
  rotate_angle = 90
  scale_factor = scale
  
  axiom = "A"
  
  rules = {}
  rules["A"] = "+BF-AFA-FB+"
  rules["B"] = "-AF+BFB+FA-"
  
  return LSystem(axiom, rules, move_dist, rotate_angle, scale_factor)

hil = init_hilbert()
print(num_iterations)
for i in range(num_iterations):
  hil.iterate()
  print(hil.current_iteration)
  
hil.draw_LSystem()  
  
print(out_points)
  
points = out_points
# ---------- end ghpython_script ----------
division_15 = Division(A=neg_4, B=2)
move_3 = Move(Geometry=area_3.Centroid, Motion=division_15)  # -> Geometry, Transform

# ----
pline = PolyLine(Vertices=ghpython_script.points, Closed=False)
ggspl = GgSimplifyPolyline(Polyline=pline, Tol=0.001)

# ---- group: Hilbert Infill (continued)
move_4 = Move(Geometry=ggspl, Motion=move_3.Geometry)  # -> Geometry, Transform
bcx_3 = BrepCurve(Brep=gate.Target3, Curve=move_4.Geometry)  # -> Curves, Points
clean_6 = CleanTree(RemoveNulls=True, RemoveInvalid=True, RemoveEmpty=True, Tree=bcx_3.Curves)
trim_5 = TrimTree(Tree=clean_6, Depth=Slider(2, range=0..10))

# ----
# [TODO]: Combine Perimeters and Infill
filter = StreamFilter(Gate=infill_2, Stream0=connect, Stream1=trim_4, Stream2=trim_2, Stream3=trim_5)
# [TODO]: Create Line Segments from Perimeters and Infill
merge = Merge(Data1=gate.Target0, Data2=filter)

topoly = CurveToPolyline(Curve=merge, ToleranceDistance=0, ToleranceAngle=0, MaxEdge=Slider(0.1, range=0..0.1))  # -> Polyline, Segments
ggspl_2 = GgSimplifyPolyline(Polyline=topoly.Polyline, Tol=0.001)
# [TODO]: Use lines for testing gcode generation then replace with line segments from slicing
explode = Explode(Curve=ggspl_2, Recursive=True)  # -> Segments, Vertices

line = Line(explode.Segments)
# [TODO]: Implement the gcode generation algorithm in Python
ghpython_script_2 = GhPythonScript(
    lines=flatten(line),
    nozzle_diameter=travel_feed_rate,
    filament_diameter=travel_feed_rate_2,
    layer_height=layer_height,
    extrusion_width=line_width,
    travel_feed_rate=travel_feed_rate_3,
    layer_change_feed_rate=travel_feed_rate_4)  # -> out, gcode_output; inputs lines: list of Line
# ---------- ghpython_script_2: Python ----------
"""
    This file contains parameters, helpers, and setup to 
    create a basic gcode generation algorithm from line segments.
    
    The main 
    
    
    Inputs:
        lines: the line segments to be converted into gcode commands for extrusion 
        nozzle_diameter: the diameter of the 3D printer's nozzle
        filament_diameter: the diameter of the 3d printing filament
        layer_height: the height of each layer in the print
        extrusion_width: the width of the extruded line from the printer
        travel_feed_rate: the speed at which the extruder moves in X and Y
        layer_change_feed_rate: the speed at which teh extruder moves when 
            changing layers in the Z direction
        extrusion_feed_rate: the speed at which the extruder move when extruding

    Output:
        gcode_output: a string with gcode commands separate by new-lines"""

__author__ = "mrivera-cu"

import rhinoscriptsyntax as rs

import math


########## CONSTANTS BELOW ###############

# GCODE COMMANDS
COMMAND_MOVE = "G1"

# GCODE PARAM NAMES
PARAM_X = "X"
PARAM_Y = "Y"
PARAM_Z = "Z"
PARAM_E = "E"
PARAM_F = "F"

# Separates commands
COMMAND_DELIMITER = "\n"

# Precision for converting floats to strings
E_VALUE_PRECISION = 5
XYZ_VALUE_PRECISION = 3

# Float equality precision
FLOAT_EQUALITY_PRECISION = 5

#### WARNING: DO NOT EDIT THE START GCODE! #####
start_gcode_lines = [";START GCODE",
    "M201 X1000 Y1000 Z200 E5000 ; sets maximum accelerations, mm/sec^2",
    "M203 X200 Y200 Z12 E120 ; sets maximum feedrates, mm / sec",
    "M204 S1250 T1250 ; sets acceleration (S) and retract acceleration (R), mm/sec^2",
    "M205 X8.00 Y8.00 Z0.40 E4.50 ; sets the jerk limits, mm/sec",
    "M205 S0 T0 ; sets the minimum extruding and travel feed rate, mm/sec",
    ";TYPE:Custom",
    "M862.3 P \"MK3S\" ; printer model check",
    "M862.1 P0.4 ; nozzle diameter check",
    "M115 U3.13.3 ; tell printer latest fw version",
    "G90 ; use absolute coordinates",
    "M83 ; extruder relative mode",
    "M104 S215 ; set extruder temp",
    "M140 S60 ; set bed temp",
    "M190 S60 ; wait for bed temp",
    "M109 S215 ; wait for extruder temp",
    "G28 W ; home all without mesh bed level",
    "G80 X86.6877 Y64.7708 W85.2412 H59.1573 ; mesh bed levelling",
    "G1 Z0.2 F720",
    "G1 Y-3 F1000 ; go outside print area",
    "G92 E0",
    "G1 X60 E9 F1000 ; intro line",
    "G1 X100 E12.5 F1000 ; intro line",
    "G92 E0",
    "M221 S95",
    "; Don't change E values below. Excessive value can damage the printer.",
    "M907 E538 ; set extruder motor current",
    "G21 ; set units to millimeters",
    "G90 ; use absolute coordinates",
    "M83 ; use relative distances for extrusion",
    "M900 K0.05 ; Filament gcode LA 1.5",
    "M900 K30 ; Filament gcode LA 1.0",
    "M107"]
    
##### WARNING: DO NOT EDIT THE END GCODE! ######
end_gcode_lines = ["; END Gcode", 
    "M204 S1000", 
    "M107", 
    ";TYPE:Custom", 
    "; Filament-specific end gcode", 
    "G1 Z180 F720 ; Move print head further up", 
    "G1 X0 Y200 F3600 ; park", 
    "G4 ; wait",
    "M221 S100 ; reset flow",
    "M900 K0 ; reset LA",
    "M104 S0 ; turn off temperature",
    "M140 S0 ; turn off heatbed",
    "M107 ; turn off fan",
    "M84 ; disable motors",
    "M73 P100 R0 ; print progress done",
    "M73 Q100 S0 ; print progress done"]

#########################################################################

# Converts a float (f) to a string with some precision of decimal places
# For example: 
# Input: f=0.1234, precision=3 
# Output: "0.123"
def float_to_string(f, precision=XYZ_VALUE_PRECISION): 
    f = float(f)
    str_format = "{value:." + str(precision) +"f}"
    return str_format.format(value=f)
    
# Helper to convert the E value to the proper precision
def e_value_to_string(e):
    return float_to_string(e, E_VALUE_PRECISION)

# Helper to convert the XYZ value to the proper precision
def xyz_value_to_string(e):
    return float_to_string(e, XYZ_VALUE_PRECISION)

#########################################################################

# Helper function to compare floats in grasshopper/python due to float precision errors
def are_floats_equal(f1, f2, epsilon=10**(-FLOAT_EQUALITY_PRECISION)):
    f1 *= 10**FLOAT_EQUALITY_PRECISION
    f2 *= 10**FLOAT_EQUALITY_PRECISION
    return math.fabs(f2 - f1) <= epsilon
    
# Helper function to compare if two points are equal (have the same coordinates)
# by handling float precision comparisons
def is_same_pt(ptA, ptB):
    return are_floats_equal(ptA[0], ptB[0]) and are_floats_equal(ptA[1], ptB[1]) and are_floats_equal(ptA[2], ptB[2])
     
     
########################################################################
# creates a string consisting of a G1 move command and 
# any associated parameters
def gcode_move(current_pos, next_pos, feed_rate=None, should_extrude=False):
    # Start with "G1" as command
    move_command_str = COMMAND_MOVE
    
    # Compare X positions
    if (not are_floats_equal(current_pos[0],next_pos[0])):
        # we have a different x position so add it as a parameter to the command
        x_value = float_to_string(next_pos[0], precision=XYZ_VALUE_PRECISION)
        # Add X<x_value> to move string, e.g., X100.00
        move_command_str += " " + PARAM_X + x_value
    
    # Compare Y positions
    if (not are_floats_equal(current_pos[1], next_pos[1])):
        # we have a different y position so add the new position as a parameter
        y_value = float_to_string(next_pos[1], precision=XYZ_VALUE_PRECISION)
        # Add Y<y_value> to move string, e.g., Y100.00
        move_command_str += " " + PARAM_Y + y_value
    
    # Compare Z position
    if (not are_floats_equal(current_pos[2], next_pos[2])):
        # we have a different z position so add the new position as a parameter
        z_value = float_to_string(next_pos[2], precision=XYZ_VALUE_PRECISION)
        # Add Z<z_value> to move string, e.g., Z100.00
        move_command_str += " " + PARAM_Z + z_value
        
    
    # [TODO]: handle "should_extrude" == true by determining the proper amount to
    # extrude using the capsule model, then append the E parameter and value
    # to the move command.
    # NOTE: YOUR FLOAT PRECISION MUST MATCH E_VALUE_PRECISION
    if (should_extrude):
        area = math.pi*(layer_height/2)**2 + (extrusion_width-layer_height)*layer_height
        dx = next_pos[0] - current_pos[0]
        dy = next_pos[1] - current_pos[1]
        dz = next_pos[2] - current_pos[2]
        length = math.sqrt(dx**2 + dy**2 + dz**2)
        vol = area*length
        len = vol/(math.pi*(filament_diameter/2)**2)
        e_value = float_to_string(len, precision=E_VALUE_PRECISION)
        move_command_str += " " + PARAM_E + e_value
    
    
    # See if we have a feedrate to use, and handle it differently than other 
    # parameters as it is an integer value
    if (feed_rate is not None):
        # feed rate is an int
        feed_rate_value = round(feed_rate)
        # Add F<feed_rate_value> to move string, e.g., F2000
        move_command_str += " " + PARAM_F + str(feed_rate_value)   
    
    # Remove excess whitespace on ends
    move_command_str = move_command_str.strip(" ")
    print(move_command_str)
    
    return move_command_str


############################################
############################################
############################################
    
''' Here's the main method of the script that uses the helper methods above '''

def generate_gcode():

    # [TODO]: Implement the algorithm to generate gcode for each layer by 
    # first to moveing to the layer height, then moving to each line segment.
    # Once at a line segment, you should move and extrude along it, 
    # then move (travel) to the next line until there are no lines left
    # For each of these movements, you should append the command to
    # the list: `all_move_commands`
    current_position = [0, 0, 0]        # start extruder at the origin
    all_move_commands = []              # list to hold for all the move commands

    for i in range(0, len(lines)):
        # Get pts of the line segment
        line = lines[i]
        line_start_position = line[0]
        line_end_position = line[1]
        
        # [TODO]: Handle moving to the next layer (Z Position)
        # NOTE- ALL Z MOVEMENTS SHOULD:
        # 1) BE INDEPENDENT MOVES(e.g., G1 Z# and not move with other positions like XYE) 
        # 2) USE THE `layer_change_feedrate`
        # 3) BE IN INCREASING ORDER
        if not (current_position[2] == line_start_position[2]):
            next_layer = [current_position[0], current_position[1], line_start_position[2]]
#            print(current_position, next_layer)
            move_z = gcode_move(current_position, next_layer, feed_rate=layer_change_feed_rate)
            all_move_commands.append(move_z)
            current_position[2] = line_start_position[2]

        # Now if our current_position is not the start of our line segment
        # we need to move (travel) to the line segment's starting point
        if not is_same_pt(current_position, line_start_position):
            # [Move to the the line_start_position
            move_to_line_start_command = gcode_move(current_position, line_start_position, feed_rate=travel_feed_rate)
            # A ppend command
            all_move_commands.append(move_to_line_start_command)
        
        # [TODO]: Once our extruder is at the start of the line, create a 
        # command to move AND extrude along 
        # the line segment using `extrusion_feed_rate`
        extrude_command = gcode_move(line_start_position, line_end_position, feed_rate=extrusion_feed_rate, should_extrude=True)

        # [TODO]: Append the move command across the line segment 
        all_move_commands.append(extrude_command)
        
        # [TODO]: Update the current position of our extruder to be at the end of the line
        current_position = line_end_position
        
    # End of for-loop above -- now create the full set of commands


    # [TODO]: Once you have all of the move commands stored as a list in
    # `all_move_commands`, combine the `start_gcode`, `all_move_commands`, and `end_gcode`
    # into one list called `gcode_lines`   
    gcode_lines = [] 
    gcode_lines += start_gcode_lines
    gcode_lines += all_move_commands
    gcode_lines += end_gcode_lines

    # --- DO NOT EDIT BELOW ----
    # The takes the combined gcode_lines list and creates a string containing each line
    # separated by a COMMAND_DELIMITER (the new-line character), and sets it 
    # to the `gcode_output`variable of this component
    output = COMMAND_DELIMITER.join(gcode_lines)
    
    return output
    
''' RUN THE MAIN FUNCITON ABOVE - DO NOT EDIT '''
# this sets the gcode commands to be the the `gcode_output` variable of this grasshopper component
gcode_output = generate_gcode()
# ---------- end ghpython_script_2 ----------
the_gcode_output = Panel(ghpython_script_2.gcode_output)
debugging_panel = Panel(ghpython_script_2.out)
pcexporttxt = ExportTXT(
    Content=the_gcode_output,
    FileLocation=panel,
    Overwrite=Toggle(True),
    Encoding="utf-8",
    Export=truebutton,
    LastSaveLocalization="neutral,N")
