# Grasshopper definition M3.gh (Grasshopper 1.0.8)

per_section = Slider(3, range=0..10)
sections = Slider(8, range=1..20)
size = Slider(0.5, range=0..10)
curve_width = Slider(0.25, range=0..1)
multiplication = Multiplication(A=per_section, B=sections)
addition = Addition(A=multiplication, B=1)
X = UnitX(Factor=1)
arrpolar = PolarArray(Geometry=X, Plane=PlaneXY(0, 0, 0), Count=addition, Angle=Slider(6.434, range=0..10))  # -> Geometry, Transform
series = Series(Start=1, Step=size, Count=addition)
multiplication_2 = Multiplication(A=arrpolar.Geometry, B=series)
scale = Scale(Geometry=multiplication_2, Center=Point(0, 0, 0), Factor=curve_width)  # -> Geometry, Transform
ln = Line(StartPoint=scale.Geometry, EndPoint=multiplication_2)

addition_2 = Addition(A=per_section, B=1)

lng = ListLength(List=ln)
subtraction = Subtraction(A=lng, B=1)
division = Division(A=subtraction, B=per_section)
int = Integer(division)
subtraction_2 = Subtraction(A=int, B=1)
dup = DuplicateData(Data=Toggle(True), Number=per_section, Order=True)  # -> flatten(Data)
series_2 = Series(Start=per_section, Step=per_section, Count=subtraction_2)
item = ListItem(List=ln, Index=series_2, Wrap=True)
weave = Weave(Pattern=[dup, Toggle(False)], Stream0=item, Stream1=ln, NullGaps=False)
partition = PartitionList(List=weave, Size=addition_2)

# ---- group: Table Top
mode = Slider(1, range=0..10)
table_thickness = Slider(0.433, range=0..10)
loft = Loft(Curves=partition, Options={Adjust=False, Closed=False, LoftEnds=0, LoftSimp=0, LoftType=0, Rebuild=10, Refit=0.01})  # -> flatten(Loft)
Z = UnitZ(Factor=table_thickness)
extr = Extrude(Base=loft, Direction=Z)

# ----
join = BrepJoin(Breps=loft)  # -> Breps, Closed
area = Area(Geometry=join.Breps)  # -> Area, Centroid

edgescvx = ConvexEdges(Brep=extr)  # -> Convex, Concave, Mixed

# ---- group: Support Ring
ring_size = Slider(3.7, range=0..10)
ring_thickness = Slider(0.7, range=0..10)
ring_height = Slider(0.506, range=0..10)
subtraction_3 = Subtraction(A=ring_size, B=ring_thickness)
cir = Circle(Plane=area.Centroid, Radius=ring_size)
cir_2 = Circle(Plane=area.Centroid, Radius=subtraction_3)
sdiff = SolidDifference(BrepsA=cir, BrepsB=cir_2)
Z_2 = UnitZ(Factor=ring_height)
neg = Negative(Value=Z_2)
extr_2 = Extrude(Base=sdiff, Direction=neg)

# ---- group: Table Top (continued)
filedge = FilletEdge(Shape=extr, Blend=mode, Metric=0, Edges=edgescvx.Convex, Radii=Slider(0.05, range=0..1))

# ---- group: Legs
leg_radius = Slider(0.7, range=0..10)
leg_slant = Slider(1.829, range=0..10)
num_legs = Slider(3, range=1..20)
leg_taper = Slider(0.522, range=0..2)
leg_height = Slider(4, range=0..10)
Z_3 = UnitZ(Factor=ring_height)
division_2 = Division(A=ring_thickness, B=2)
neg_2 = Negative(Value=Z_3)
subtraction_4 = Subtraction(A=ring_size, B=division_2)
vec = VectorXYZ(XComponent=subtraction_4, YComponent=0, ZComponent=0)  # -> Vector, Length
neg_3 = Negative(Value=leg_height)
vec_2 = VectorXYZ(XComponent=leg_slant, YComponent=0, ZComponent=neg_3)  # -> Vector, Length
pi = Pi(Factor=2)

# ----
addition_3 = Addition(A=area.Centroid, B=neg_2)

# ---- group: Legs (continued)
addition_4 = Addition(A=addition_3, B=vec.Vector)
cir_3 = Circle(Plane=addition_4, Radius=leg_radius)
move = Move(Geometry=cir_3, Motion=vec_2.Vector)  # -> Geometry, Transform
area_2 = Area(Geometry=move.Geometry)  # -> Area, Centroid
scale_2 = Scale(Geometry=move.Geometry, Center=area_2.Centroid, Factor=leg_taper)  # -> Geometry, Transform
loft_2 = Loft(
    Curves=[cir_3, scale_2.Geometry],
    Options={Adjust=False, Closed=False, LoftEnds=0, LoftSimp=0, LoftType=0, Rebuild=10, Refit=0.01})
cap = CapHoles(Brep=loft_2)
arrpolar_2 = PolarArray(Geometry=cap, Plane=area.Centroid, Count=num_legs, Angle=pi)  # -> Geometry, Transform

# ----
sunion = SolidUnion(Breps=flatten([filedge, arrpolar_2.Geometry, extr_2]))
